# Grasshopper definition beam_joints.gh (Grasshopper 1.0.7)

# ----
# Reload Python Modules (if Module Code is Changed)
python_module_to_reload = Panel("""compas
compas_fab
roslibpy
integral_timber_joints""")
# Development Tools
reload = Button()
py = PythonScript(reload_module_button=Toggle(True), module_names=python_module_to_reload)  # inputs module_names: list
# ---------- py: Python ----------
import compas_ghpython
from compas_ghpython import unload_modules
if reload_module_button:
    for module in module_names:
        unload_modules(module)
# ---------- end py ----------

# ----
# Check Path and Environment
compas_version = GhPythonScript()  # -> out, compas_version, compas_fab_version, compas_path, compas_fab_path, compas_env_name, python_directory
# ---------- compas_version: Python ----------
__author__ = "leungp"
__version__ = "2020.04.20"

import rhinoscriptsyntax as rs
import compas
import compas_fab
compas_version  = compas.__version__
compas_fab_version = compas_fab.__version__
import os
compas_path = os.path.abspath(compas.__file__)
compas_fab_path = os.path.abspath(compas_fab.__file__)

import compas_bootstrapper
compas_env_name = compas_bootstrapper.ENVIRONMENT_NAME
python_directory = compas_bootstrapper.PYTHON_DIRECTORY
# ---------- end compas_version ----------
compas_environment_name = Panel(compas_version.compas_env_name)
compas_version_2 = Panel(compas_version.compas_version)
compas_fab_version = Panel(compas_version.compas_fab_version)
compas_path = Panel(compas_version.compas_path)
compas_fab_path = Panel(compas_version.compas_fab_path)
python_directory = Panel(compas_version.python_directory)

# ----
# Auto Create Planar Lap Joints on Intersecting beams
number_slider = Slider(700, range=0..1000)
pt = ConstructPoint(XCoordinate=number_slider, YCoordinate=Slider(500, range=0..1000), ZCoordinate=0)
pt_2 = ConstructPoint(XCoordinate=Slider(0, range=0..1000), YCoordinate=Slider(629, range=0..1000), ZCoordinate=0)
xy = XYPlane(Origin=pt)
prot = RotatePlane(Plane=xy, Angle=degrees(Slider(140, range=-80..180)))
beam = GhPythonScript(
    plane=prot,
    length=Slider(700, range=0..2000),
    width=Slider(100, range=0..100),
    height=Slider(100, range=0..1000),
    name="b2")  # -> out, beam, assembly; inputs plane: Plane
# ---------- beam: Python ----------
from compas_rhino.geometry import RhinoMesh, RhinoPlane

from integral_timber_joints.geometry import Beam
from integral_timber_joints.assembly import Assembly

frame = RhinoPlane.from_geometry(plane).to_compas()

beam = Beam(frame, length, width, height, name)

assembly = Assembly()
assembly.add_beam(beam)
assembly.get_beam_mesh_in_wcf(name, True)
# ---------- end beam ----------
xy_2 = XYPlane(Origin=pt_2)
prot_2 = RotatePlane(Plane=xy_2, Angle=degrees(Slider(0, range=0..100)))
beam_2 = GhPythonScript(
    plane=prot_2,
    length=Slider(800, range=0..3000),
    width=Slider(100, range=0..100),
    height=Slider(100, range=0..1000),
    name="b1")  # -> out, beam, assembly; inputs plane: Plane; same code as beam
jointhalflap = GhPythonScript(beam1=beam_2.beam, beam2=beam.beam, has_screw=Toggle(True))  # -> out, assembly, joint1_mesh, joint2_mesh; inputs has_screw: Boolean
# ---------- jointhalflap: Python ----------
from compas_ghpython import unload_modules
unload_modules('integral_timber_joints')
from integral_timber_joints.assembly import Assembly
from integral_timber_joints.geometry import JointHalfLap

assembly = Assembly()
assembly.add_beam(beam1)
assembly.add_beam(beam2)

joint1, joint2, screw_line = JointHalfLap.from_beam_beam_intersection(beam1, beam2)
joint1.has_screw = has_screw
joint1.screw_head_side = True
joint2.has_screw = has_screw
joint2.screw_head_side = False

assembly.add_joint_pair(joint1, joint2, beam1.name, beam2.name)

assembly.get_beam_mesh_in_wcf(beam1.name, True)
assembly.get_beam_mesh_in_wcf(beam2.name, True)

from compas_ghpython.artists import MeshArtist
joint1_mesh = [MeshArtist(mesh).draw() for mesh in joint1.get_feature_meshes(assembly.beam(beam1.name))]
joint2_mesh = [MeshArtist(mesh).draw() for mesh in joint2.get_feature_meshes(assembly.beam(beam2.name))]

print joint1.distance
print joint2.distance
# ---------- end jointhalflap ----------
basic_assembly_preview = GhPythonScript(assembly=jointhalflap.assembly, beam_ids="b1")  # -> out, beam_mesh_prev; inputs beam_ids: list
# ---------- basic_assembly_preview: Python ----------
from compas_ghpython.artists import MeshArtist

beam_mesh_prev = []
if beam_ids == []:
    beam_ids = assembly.beam_ids()
    
for beam_id in beam_ids:
    beam = assembly.beam(beam_id)
    beam_mesh_prev.append(MeshArtist(beam.cached_mesh).draw())
# ---------- end basic_assembly_preview ----------
basic_assembly_preview_2 = GhPythonScript(assembly=jointhalflap.assembly, beam_ids="b2")  # -> out, beam_mesh_prev; inputs beam_ids: list; same code as basic_assembly_preview
preview = CustomPreview(Geometry=jointhalflap.joint2_mesh, Material=ColourSwatch(SwatchColor=RGBA(0, 255, 204, 148)))
Z = UnitZ(Factor=120)
move = Move(Geometry=basic_assembly_preview.beam_mesh_prev, Motion=Z)  # -> Geometry, Transform
preview_2 = CustomPreview(Geometry=basic_assembly_preview.beam_mesh_prev, Material=ColourSwatch(SwatchColor=RGBA(0, 255, 204, 148)))
preview_3 = CustomPreview(Geometry=basic_assembly_preview_2.beam_mesh_prev, Material=ColourSwatch(SwatchColor=RGBA(0, 255, 204, 148)))

assembly_preview = AssemblyPreview()

# ----
# Moving Beam
number_slider_2 = Slider(0, range=0..1000)
number_slider_3 = Slider(800, range=0..3000)
number_slider_4 = Slider(100, range=0..100)
number_slider_5 = Slider(100, range=0..200)
pt_3 = ConstructPoint(XCoordinate=number_slider_2, YCoordinate=Slider(1200, range=0..2100), ZCoordinate=0)
xy_3 = XYPlane(Origin=pt_3)
prot_3 = RotatePlane(Plane=xy_3, Angle=degrees(Slider(22, range=0..100)))
beam_3 = GhPythonScript(plane=prot_3, length=number_slider_3, width=number_slider_4, height=number_slider_5, name="b1")  # -> out, beam, assembly; inputs plane: Plane; same code as beam

pln = Plane(prot_3)
deplane = DeconstructPlane(Plane=pln)  # -> Origin, XAxis, YAxis, ZAxis
amp = Amplitude(Vector=deplane.YAxis, Amplitude=expr("x/2", number_slider_5))
amp_2 = Amplitude(Vector=deplane.XAxis, Amplitude=expr("x/2", number_slider_3))
amp_3 = Amplitude(Vector=deplane.ZAxis, Amplitude=expr("x/2", number_slider_4))
addition = Addition(A=amp_2, B=amp, C=amp_3)
move_2 = Move(Geometry=pln, Motion=addition)  # -> Geometry, Transform

# ----
# Stationary Beam
axle_angle = Slider(18, range=-100..100)
out_of_plane_angle = Slider(-12, range=-50..50)
plane_angle = Slider(74, range=25..155)
downward_offset = Slider(25, range=-20..60)
pln_joint_center = Plane(move_2.Geometry)
deplane_2 = DeconstructPlane(Plane=pln_joint_center)  # -> Origin, XAxis, YAxis, ZAxis
neg = Negative(Value=downward_offset)
rot3d = Rotate3D(Geometry=pln_joint_center, Angle=degrees(axle_angle), Center=pln_joint_center, Axis=deplane_2.XAxis)  # -> Geometry, Transform
rot3d_2 = Rotate3D(Geometry=rot3d.Geometry, Angle=degrees(out_of_plane_angle), Center=pln_joint_center, Axis=deplane_2.YAxis)  # -> Geometry, Transform
amp_4 = Amplitude(Vector=deplane_2.ZAxis, Amplitude=neg)
rot3d_3 = Rotate3D(Geometry=rot3d_2.Geometry, Angle=degrees(plane_angle), Center=pln_joint_center, Axis=deplane_2.ZAxis)  # -> Geometry, Transform
move_3 = Move(Geometry=rot3d_3.Geometry, Motion=amp_4)  # -> Geometry, Transform
pln_2 = Plane(move_3.Geometry)

number_slider_6 = Slider(800, range=0..3000)
number_slider_7 = Slider(100, range=0..100)
pln_3 = Plane(pln_2)
number_slider_8 = Slider(100, range=0..200)
deplane_3 = DeconstructPlane(Plane=pln_3)  # -> Origin, XAxis, YAxis, ZAxis
amp_5 = Amplitude(Vector=deplane_3.YAxis, Amplitude=expr("x/2", number_slider_8))
amp_6 = Amplitude(Vector=deplane_3.XAxis, Amplitude=expr("x/2", number_slider_6))
amp_7 = Amplitude(Vector=deplane_3.ZAxis, Amplitude=expr("x/2", number_slider_7))
addition_2 = Addition(A=amp_6, B=amp_5, C=amp_7)
rev = Reverse(Vector=addition_2)
move_4 = Move(Geometry=pln_3, Motion=rev)  # -> Geometry, Transform
pln_4 = Plane(move_4.Geometry)
beam_4 = GhPythonScript(plane=pln_4, length=number_slider_6, width=number_slider_7, height=number_slider_8, name="b2")  # -> out, beam, assembly; inputs plane: Plane; same code as beam

number_slider_9 = Slider(765, range=0..1000)
number_slider_10 = Slider(1200, range=0..2100)
pt_4 = ConstructPoint(XCoordinate=number_slider_9, YCoordinate=number_slider_10, ZCoordinate=0)
pt_5 = ConstructPoint(XCoordinate=number_slider_9, YCoordinate=number_slider_10, ZCoordinate=Slider(115, range=0..200))
ln = Line(StartPoint=pt_4, EndPoint=pt_5)
screw = GhPythonScript(center_line=ln, head_side_thickness=Slider(48, range=0..100))  # -> out, screw, feature_m_mesh, feature_s_mesh; inputs center_line: Line
# ---------- screw: Python ----------
from compas_ghpython import unload_modules
unload_modules('integral_timber_joints')
from compas_ghpython.artists import MeshArtist
from compas_rhino.geometry import RhinoMesh, RhinoPlane, RhinoLine

from integral_timber_joints.geometry import Screw_SL

center_line = RhinoLine.from_geometry(center_line).to_compas()

screw = Screw_SL.AutoLength_Factory(center_line=center_line, head_side_thickness=head_side_thickness)

feature_m_mesh = [MeshArtist(mesh).draw() for mesh in screw.get_head_side_feature_meshes()]
feature_s_mesh = [MeshArtist(mesh).draw() for mesh in screw.get_thread_side_feature_meshes()]
# ---------- end screw ----------

basic_assembly_preview_3 = GhPythonScript(assembly=beam_3.assembly)  # -> out, beam_mesh_prev; inputs beam_ids: list; disabled
# ---------- basic_assembly_preview_3: Python ----------
from compas_ghpython.artists import MeshArtist

beam_mesh_prev = []
if beam_ids == []:
    beam_ids = assembly.beam_ids()

for beam_id in beam_ids:
    beam = assembly.beam(beam_id)
    beam_mesh_prev.append(MeshArtist(beam.cached_mesh).draw())
# ---------- end basic_assembly_preview_3 ----------
swatch = ColourSwatch(SwatchColor=RGBA(102, 255, 0, 148))  # disabled
preview_4 = CustomPreview(Geometry=basic_assembly_preview_3.beam_mesh_prev, Material=swatch)  # disabled

basic_assembly_preview_4 = GhPythonScript(assembly=beam_4.assembly)  # -> out, beam_mesh_prev; inputs beam_ids: list; same code as basic_assembly_preview_3
preview_5 = CustomPreview(Geometry=basic_assembly_preview_4.beam_mesh_prev, Material=ColourSwatch(SwatchColor=RGBA(255, 157, 0, 148)))

geo = Geometry(screw.feature_s_mesh)

# ----
# Auto Create non-Planar Lap Joints on Intersecting beams
number_slider_11 = Slider(70, range=0..100)
join_2_2_nonplanarlap = GhPythonScript(beam_move=beam_3.beam, beam_stay=beam_4.beam, joint_thickness=number_slider_11, has_screw=Toggle(True))  # -> out, assembly, joint1_mesh, joint2_mesh, test; inputs has_screw: Boolean
# ---------- join_2_2_nonplanarlap: Python ----------
from compas_ghpython import unload_modules
unload_modules('integral_timber_joints')
from integral_timber_joints.assembly import Assembly
from integral_timber_joints.geometry import JointNonPlanarLap

from copy import deepcopy
beam_move = deepcopy(beam_move)
beam_stay = deepcopy(beam_stay)

assembly = Assembly()
assembly.add_beam(beam_move)
assembly.add_beam(beam_stay)

joint_m, joint_s, screw_line = JointNonPlanarLap.from_beam_beam_intersection(beam_move, beam_stay, joint_thickness)
joint_m.has_screw = has_screw
joint_s.has_screw = has_screw

assembly.add_joint_pair(joint_m, joint_s, beam_move.name, beam_stay.name)

from compas_ghpython.artists import MeshArtist

joint1_mesh = [MeshArtist(mesh).draw() for mesh in joint_m.get_feature_meshes(assembly.beam(beam_move.name))]
joint2_mesh = [MeshArtist(mesh).draw() for mesh in joint_s.get_feature_meshes(assembly.beam(beam_stay.name))]
try:
    assembly.update_beam_mesh_with_joints(beam_move.name, True)
    assembly.update_beam_mesh_with_joints(beam_stay.name, True)
except:
    pass
# ---------- end join_2_2_nonplanarlap ----------
geo_2 = Geometry(join_2_2_nonplanarlap.joint1_mesh)
geo_3 = Geometry(join_2_2_nonplanarlap.joint2_mesh)
basic_assembly_preview_5 = GhPythonScript(assembly=join_2_2_nonplanarlap.assembly, beam_ids="b1")  # -> out, beam_mesh_prev; inputs beam_ids: list
# ---------- basic_assembly_preview_5: Python ----------
from compas_ghpython.artists import MeshArtist

beam_mesh_prev = []
if beam_ids == []:
    beam_ids = assembly.beam_ids()
    
for beam_id in beam_ids:
    beam = assembly.beam(beam_id)
    beam_mesh_prev.append(MeshArtist(assembly.get_beam_mesh_in_wcf(beam_id)).draw())
# ---------- end basic_assembly_preview_5 ----------
basic_assembly_preview_6 = GhPythonScript(assembly=join_2_2_nonplanarlap.assembly, beam_ids="b2")  # -> out, beam_mesh_prev; inputs beam_ids: list; same code as basic_assembly_preview_5
Z_2 = UnitZ(Factor=120)
move_5 = Move(Geometry=basic_assembly_preview_5.beam_mesh_prev, Motion=Z_2)  # -> Geometry, Transform
preview_6 = CustomPreview(Geometry=move_5.Geometry, Material=ColourSwatch(SwatchColor=RGBA(0, 255, 47, 148)))
preview_7 = CustomPreview(Geometry=basic_assembly_preview_6.beam_mesh_prev, Material=ColourSwatch(SwatchColor=RGBA(0, 255, 204, 148)))

# ----
# Rhino AssemblyArtist Example (will add brep geometry to Rhino Doc directly)
basic_assembly_preview_7 = GhPythonScript(assembly=join_2_2_nonplanarlap.assembly)  # -> out, beam_nurbs; inputs beam_ids: list
# ---------- basic_assembly_preview_7: Python ----------
from compas_ghpython import unload_modules
unload_modules('integral_timber_joints')
from compas_ghpython.utilities import draw_mesh
import scriptcontext
import Rhino
scriptcontext.doc = Rhino.RhinoDoc.ActiveDoc
beam_nurbs = []

from integral_timber_joints.rhino.assembly_artist import AssemblyNurbsArtist
aa = AssemblyNurbsArtist(assembly)

if not beam_ids:
    beam_ids = assembly.beam_ids()
    
for beam_id in beam_ids:
    nurbs = aa.draw_beam(beam_id)
    beam_nurbs.append(nurbs)
scriptcontext.doc = ghdoc
# ---------- end basic_assembly_preview_7 ----------

# ----
# Lap Joint on just one side
number_slider_12 = Slider(1000, range=0..1000)
xy_4 = XYPlane(Origin=Point(0, 0, 0))
beam_5 = GhPythonScript(plane=xy_4, length=number_slider_12, width=Slider(100, range=0..100), height=Slider(140, range=0..1000), name="b1")  # -> out, beam, assembly; inputs plane: Plane; same code as beam
joint_90lap = GhPythonScript(
    assembly=beam_5.assembly,
    face_id=Slider(1, range=1..4),
    distance=Slider(309, range=0..1000),
    width=Slider(82, range=0..100),
    length=Slider(100, range=0..100),
    height=Slider(24, range=0..100))  # -> out, assembly_out
# ---------- joint_90lap: Python ----------
from integral_timber_joints.geometry import Beam, Joint_90lap
from copy import deepcopy

empty_beam = Beam(None,1,2,3,'b2')
assembly_out = deepcopy(assembly)

assembly_out.add_beam(empty_beam)

joint = Joint_90lap(distance, face_id, length, width, height)
assembly_out.add_one_joint(joint, assembly_out.sequence[0], assembly_out.sequence[1])
assembly_out.get_beam_mesh_in_wcf(assembly_out.sequence[0])
# ---------- end joint_90lap ----------

assembly_preview_2 = AssemblyPreview(assembly=joint_90lap.assembly_out, beam_ids="b1", update_cache=Toggle(True))

preview_8 = CustomPreview(Geometry=assembly_preview_2, Material=ColourSwatch(SwatchColor=RGBA(102, 255, 0, 148)))

# ----
# Lap Joint on just one side
number_slider_13 = Slider(1000, range=0..1000)
xy_5 = XYPlane(Origin=Point(0, 200, 0))
beam_6 = GhPythonScript(plane=xy_5, length=number_slider_13, width=Slider(100, range=0..100), height=Slider(100, range=0..1000), name="b1")  # -> out, beam, assembly; inputs plane: Plane; same code as beam
jointhalflap_2 = GhPythonScript(
    assembly=beam_6.assembly,
    face_id=Slider(4, range=1..4),
    angle=Slider(121, range=10..170),
    distance=Slider(245, range=0..1000),
    width=Slider(100, range=0..100),
    length=Slider(43, range=0..100),
    height=Slider(40, range=0..100))  # -> out, assembly_out, joint_mesh
# ---------- jointhalflap_2: Python ----------
from integral_timber_joints.geometry import Beam, JointHalfLap
from copy import deepcopy

from compas_ghpython.artists import MeshArtist

empty_beam = Beam(None,1,2,3,'b2')
assembly_out = deepcopy(assembly)

assembly_out.add_beam(empty_beam)

joint = JointHalfLap(face_id, distance, angle, length, width, height)
assembly_out.add_one_joint(joint, assembly_out.sequence[0], assembly_out.sequence[1])
assembly_out.get_beam_mesh_in_wcf(assembly_out.sequence[0])

joint_mesh = [MeshArtist(mesh).draw() for mesh in joint.get_feature_meshes(assembly_out.beam(assembly_out.sequence[0]))]
# ---------- end jointhalflap_2 ----------
clamp_frame = GhPythonScript(assembly=jointhalflap_2.assembly_out, beam_id="b1")  # -> out, frames, b
# ---------- clamp_frame: Python ----------
frames = []

from compas_ghpython import draw_frame
for joint in assembly.get_joints_of_beam(beam_id):
    for frame in joint.get_clamp_frames(assembly.beam(beam_id)):
        frames.append(draw_frame(frame))
# ---------- end clamp_frame ----------
item = ListItem(List=clamp_frame.frames, Index=0, Wrap=True)

assembly_preview_3 = AssemblyPreview(assembly=jointhalflap_2.assembly_out, beam_ids="b1", update_cache=Toggle(True))

preview_9 = CustomPreview(Geometry=assembly_preview_3, Material=ColourSwatch(SwatchColor=RGBA(102, 255, 0, 148)))

# ----
# Simulating Flip Joint
swap_faceid_to_opposite_face = GhPythonScript(assembly=jointhalflap_2.assembly_out)  # -> out, assembly_out
# ---------- swap_faceid_to_opposite_face: Python ----------
from copy import deepcopy

from compas_ghpython.artists import MeshArtist

assembly_out = deepcopy(assembly)
beam_id = assembly_out.sequence[0]
assembly_out.joint((assembly_out.sequence[0], assembly_out.sequence[1])).swap_faceid_to_opposite_face()
assembly_out.get_beam_mesh_in_wcf(beam_id)
# ---------- end swap_faceid_to_opposite_face ----------
Z_3 = UnitZ(Factor=Slider(237, range=0..1000))

assembly_preview_4 = AssemblyPreview(assembly=swap_faceid_to_opposite_face.assembly_out, beam_ids="b1", update_cache=Toggle(True))

move_6 = Move(Geometry=assembly_preview_4, Motion=Z_3)  # -> Geometry, Transform
preview_10 = CustomPreview(Geometry=move_6.Geometry, Material=ColourSwatch(SwatchColor=RGBA(255, 149, 0, 148)))

# ==== cluster AssemblyPreview
beam_ids = ClusterInput()
update_cache = ClusterInput()
assembly = ClusterInput()
basic_assembly_preview = GhPythonScript(assembly=assembly, beam_ids=beam_ids, update_cache=update_cache)  # -> out, beam_mesh_prev; inputs beam_ids: list
# ---------- basic_assembly_preview: Python ----------
from compas_ghpython.artists import MeshArtist

beam_mesh_prev = []
if beam_ids == []:
    beam_ids = assembly.beam_ids()

for beam_id in beam_ids:
    beam = assembly.beam(beam_id)
    mesh = assembly.get_beam_mesh_in_wcf(beam_id, not update_cache)
    beam_mesh_prev.append(MeshArtist(mesh).draw())
# ---------- end basic_assembly_preview ----------
beam_mesh_prev = ClusterOutput(basic_assembly_preview.beam_mesh_prev)
